# Dynamo graph Fill_Centroid.dyn (Dynamo 2.3.0.5885)
# packages: spring nodes 203.1.0

current = Document.Current()
activeView = Document.ActiveView(document=current)
family_types = FamilyTypes("gen_annot_AR_downlight:gen_annot_AR_downlight")
select_model_element = DSModelElementSelection()  # 1 picked in the model; graph input
ꟿ_collect_elementsketch = Custom[ꟿ Collect.ElementSketch](element=select_model_element)  # package spring nodes
flatten = List.Flatten(list=ꟿ_collect_elementsketch.curves)
watch = Watch(flatten)
byJoinedCurves = PolyCurve.ByJoinedCurves(curves=watch)
code_block = CodeBlock { 1000; }
extrudeAsSolid = Curve.ExtrudeAsSolid(curve=byJoinedCurves, distance=code_block)
centroid = Solid.Centroid(solid=extrudeAsSolid)

# group: FamilyInstance.ByViewAndPoint (springs node)
python_script = Python(IN[0]=activeView, IN[1]=family_types, IN[2]=centroid)  # unwired: IN[3]
# ---------- python_script.python (44 lines) ----------
#Copyright(c) 2016, Dimitar Venkov;
# @5devene, dimitar.ven@gmail.com

import clr

clr.AddReference("RevitServices")
import RevitServices
from RevitServices.Persistence import DocumentManager
from RevitServices.Transactions import TransactionManager
doc = DocumentManager.Instance.CurrentDBDocument

clr.AddReference("RevitAPI")
import Autodesk

clr.AddReference("RevitNodes")
import Revit
clr.ImportExtensions(Revit.Elements)
clr.ImportExtensions(Revit.GeometryConversion)

def tolist(obj1):
	if hasattr(obj1,"__iter__"): return obj1
	else: return [obj1]

view = UnwrapElement(tolist(IN[0]))
ftype = UnwrapElement(tolist(IN[1]))
fpts = UnwrapElement(tolist(IN[2]))
persistent = not IN[3]

OUT = []
ftp_len = len(ftype) == 1
view_len = len(view) == 1

TransactionManager.Instance.EnsureInTransaction(doc)
for i in xrange(len(fpts) ):
	p = fpts[i].ToXyz(True)
	j = 0 if ftp_len else i
	k = 0 if view_len else i
	try:
		if not ftype[j].IsActive : ftype[j].Activate()
		nf = doc.Create.NewFamilyInstance(p, ftype[j], view[k])
		OUT.append(nf.ToDSType(persistent) )
	except:
		OUT.append(None)
TransactionManager.Instance.TransactionTaskDone();
# ----------------------------------------
code_block_2 = CodeBlock { "view"; "type"; "point"; "track"; }
