# Dynamo graph Print_Current.dyn (Dynamo 2.6.1.8786)

current = Document.Current()
activeView = Document.ActiveView(document=current)
string_from_object = FromObject(obj=activeView)
code_block = CodeBlock { "Sheet"; }
contains = String.Contains(str=string_from_object, searchFor=code_block)
watch = Watch(activeView)

# group: check if a user in a view not in a Sheet --> get the Sheet
code_block_2 = CodeBlock { "Sheets"; }
byName = Category.ByName(name=code_block_2)
all_elements_of_category = ElementsOfCategory(Category=byName)
string_from_object_2 = FromObject(obj=all_elements_of_category)
code_block_3 = CodeBlock { "Sheet(Name = "; }
split = String.Split(str=string_from_object_2, separator0=code_block_3)
code_block_4 = CodeBlock { " )"; }
split_2 = String.Split(str=split, separator0=code_block_4)
code_block_5 = CodeBlock { "Sheet Name"; }
parameterByName = Parameter.ParameterByName(element=watch, name=code_block_5)
string_from_object_3 = FromObject(obj=parameterByName)
code_block_6 = CodeBlock { "Sheet Name : "; }
split_3 = String.Split(str=string_from_object_3, separator0=code_block_6)
flatten = List.Flatten(list=split_3)
contains_2 = String.Contains(str=split_2, searchFor=flatten, lacing=Longest)
flatten_2 = List.Flatten(list=contains_2)
filterByBoolMask = List.FilterByBoolMask(list=all_elements_of_category, mask=flatten_2)
watch_2 = Watch(filterByBoolMask.in)

if_ = If(test=contains, true=activeView, false=filterByBoolMask.in)
firstItem = List.FirstItem(list=if_)
code_block_7 = CodeBlock { "Select"; }
printer = StringInput("pdfFactory Pro")
get_all_print_settings = Python()  # unwired: IN[0]
# ---------- get_all_print_settings.python (29 lines) ----------
import clr

clr.AddReference('RevitAPI')
from Autodesk.Revit.DB import *
clr.AddReference("RevitNodes")
import Revit
clr.ImportExtensions(Revit.Elements)

clr.AddReference("RevitServices")
import RevitServices
from RevitServices.Persistence import DocumentManager
from RevitServices.Transactions import TransactionManager


doc = DocumentManager.Instance.CurrentDBDocument

yy = FilteredElementCollector(doc).OfClass(PrintSetting).WhereElementIsNotElementType().ToElements()

zz = []
for i in yy: zz.append(i.Name)

t = zip(zz,yy)

flat_list = []
for sublist in t:
    for item in sublist:
        flat_list.append(item)

OUT = flat_list
# ----------------------------------------
get_the_titleblock_size = Python(IN[0]=if_)
# ---------- get_the_titleblock_size.python (25 lines) ----------
import clr
clr.AddReference('RevitNodes')
import Revit
clr.ImportExtensions(Revit.GeometryConversion)

clr.AddReference('RevitAPI')
import Autodesk
from Autodesk.Revit.DB import *

clr.AddReference("RevitServices")
import RevitServices
from RevitServices.Persistence import DocumentManager
doc = DocumentManager.Instance.CurrentDBDocument

toList = lambda x : x if hasattr(x, '__iter__') else [x]
out= []

viewlst = toList(UnwrapElement(IN[0]))
for view in viewlst:
	titleBkl = FilteredElementCollector(doc, view.Id).OfClass(FamilyInstance).OfCategory(BuiltInCategory.OST_TitleBlocks).FirstElement()
	bbx = titleBkl.get_BoundingBox(view)
	width = bbx.Max.ToPoint().X - bbx.Min.ToPoint().X
	height = bbx.Max.ToPoint().Y - bbx.Min.ToPoint().Y
	out.append("{} x {}".format(width, height))
OUT = out
# ----------------------------------------
string = StringInput(" x ")
split_4 = String.Split(str=get_the_titleblock_size, separator0=string)
flatten_3 = List.Flatten(list=split_4)
firstItem_2 = List.FirstItem(list=flatten_3)
get_name_from_size = Python(IN[0]=firstItem_2)
# ---------- get_name_from_size.python (9 lines) ----------
inp = int(float(IN[0]))
outp = []

if inp == 841: outp.append('A1')
elif inp==594: outp.append('A2')
elif inp==297: outp.append('A4')		
else: outp.append('A3')#default scenrio
		
OUT = outp[0]
# ----------------------------------------
find_from_name = Python(IN[0]=get_all_print_settings, IN[1]=get_name_from_size)
# ---------- find_from_name.python (17 lines) ----------
inp = IN[0]
search = IN[1]
z = map(str,inp)

filter = []

for i in z:
	if search in i: filter.append("True")
	else: filter.append("False")

x = []
for i in range(0,len(z)):
	if filter[i] == 'True': x.append(inp[i+1])

if not x: x.append(inp[1])

OUT = x
# ----------------------------------------
run_it = BoolSelector(true)
print_pdf_by_https_archi_lab_net = Python(IN[0]=firstItem, IN[1]=code_block_7, IN[3]=printer, IN[4]=find_from_name, IN[6]=run_it)  # "print PDF by https://archi-lab.net/printing-pdfs-w-dynamo/"; unwired: IN[2], IN[5]
# ---------- print_pdf_by_https_archi_lab_net.python (118 lines) ----------
#Copyright(c) 2015, Konrad K Sobon
# @arch_laboratory, http://archi-lab.net

import clr
clr.AddReference('ProtoGeometry')
from Autodesk.DesignScript.Geometry import *

# Import Element wrapper extension methods
clr.AddReference("RevitNodes")
import Revit
clr.ImportExtensions(Revit.Elements)

# Import geometry conversion extension methods
clr.ImportExtensions(Revit.GeometryConversion)

# Import DocumentManager and TransactionManager
clr.AddReference("RevitServices")
import RevitServices
from RevitServices.Persistence import DocumentManager
from RevitServices.Transactions import TransactionManager

doc = DocumentManager.Instance.CurrentDBDocument
uiapp = DocumentManager.Instance.CurrentUIApplication
app = uiapp.Application

# Import RevitAPI
clr.AddReference("RevitAPI")
import Autodesk
from Autodesk.Revit.DB import *

import sys
pyt_path = r'C:\Program Files (x86)\IronPython 2.7\Lib'
sys.path.append(pyt_path)
import System

#The inputs to this node will be stored as a list in the IN variable.
dataEnteringNode = IN

sheets = IN[0]
pRange = System.Enum.Parse(Autodesk.Revit.DB.PrintRange, IN[1])
#combined = IN[2]
printerName = IN[3]
printSetting = IN[4][0]
filePath = IN[5]
runIt = IN[6]

if isinstance(sheets, list):
	viewSheets = []
	for i in sheets:
		viewSheets.append(UnwrapElement(i))
else:
	viewSheets = UnwrapElement(sheets)

def PrintView(doc, sheet, pRange, printerName, printSetting):
	# create view set 
	viewSet = ViewSet()
	viewSet.Insert(sheet)
	# determine print range
	printManager = doc.PrintManager
	printManager.PrintRange = pRange
	printManager.Apply()
	# make new view set current
	viewSheetSetting = printManager.ViewSheetSetting
	viewSheetSetting.CurrentViewSheetSet.Views = viewSet
	# set printer
	printManager.SelectNewPrintDriver(printerName)
	printManager.Apply()
	# set combined and print to file

	try:
		printSetup = printManager.PrintSetup
		printSetup.CurrentPrintSetting = printSetting
		printManager.Apply()
	except:
		pass
	# save settings and submit print
	TransactionManager.Instance.EnsureInTransaction(doc)
	viewSheetSetting.SaveAs("tempSetName")
	printManager.Apply()
	printManager.SubmitPrint()
	viewSheetSetting.Delete()
	TransactionManager.Instance.TransactionTaskDone()
	
	return True

try:
	viewSets = FilteredElementCollector(doc).OfClass(ViewSheetSet)
	for i in viewSets:
		if i.Name == "tempSetName":
			TransactionManager.Instance.EnsureInTransaction(doc)
			doc.Delete(i.Id)
			TransactionManager.Instance.ForceCloseTransaction()
		else:
			continue
		
	errorReport = None
	message = "Success"
	if runIt:
		if isinstance(viewSheets, list) and isinstance(printSetting, list):
			for i, j in zip(viewSheets, printSetting):
				PrintView(doc, i, pRange, printerName,  j)
		elif isinstance(viewSheets, list) and not isinstance(printSetting, list):
			for i in viewSheets:
				PrintView(doc, i, pRange, printerName, printSetting)
		elif not isinstance(viewSheets, list) and not isinstance(printSetting, list):
			PrintView(doc, viewSheets, pRange, printerName, printSetting)
	else:
		message = "Set RunIt to True"
except:
	# if error accurs anywhere in the process catch it
	import traceback
	errorReport = traceback.format_exc()
	
#Assign your output to the OUT variable
if errorReport == None:
	OUT = message
else:
	OUT = errorReport
# ----------------------------------------
code_block_8 = CodeBlock { "0_views"; "1 print range"; "3 printer name"; "4 print settings"; "6 runit"; }
code_block_9 = CodeBlock { "this is for automatic sheet sizing"; }
watch_3 = Watch(if_)
