# Dynamo graph Print_Current_Toshiba.dyn (Dynamo 2.10.1.3976)

# group: get the selected sheets if any
select_model_elements = Python()  # IronPython2; unwired: IN[0]
# ---------- select_model_elements.python (27 lines) ----------
import clr
clr.AddReference('RevitNodes')
import Revit
clr.ImportExtensions(Revit.GeometryConversion)

clr.AddReference('RevitAPI')
import Autodesk
from Autodesk.Revit.DB import *

clr.AddReference("RevitServices")
import RevitServices
from RevitServices.Persistence import DocumentManager
doc = DocumentManager.Instance.CurrentDBDocument
uiapp = DocumentManager.Instance.CurrentUIApplication
uidoc = DocumentManager.Instance.CurrentUIApplication.ActiveUIDocument
app = uiapp.Application


ids = uidoc.Selection.GetElementIds()
elems = []
for id in ids:
	try:
		elems.append(doc.GetElement(id))
	except:
		elems.append('Element retrieval failed')

OUT = elems
# ----------------------------------------
getCategory = Element.GetCategory(element=select_model_elements)
input_check = Python(IN[0]=getCategory)  # IronPython2
# ---------- input_check.python (8 lines) ----------
input = IN[0]
elements = []

if isinstance(input, list): 
	for i in input:	elements.append(i)
else: elements = [input]
		
OUT = elements
# ----------------------------------------
code_block = CodeBlock { "Sheets"; }
byName = Category.ByName(name=code_block)
input_check_2 = Python(IN[0]=select_model_elements)  # IronPython2; same code as input_check
category_filter = Python(IN[0]=input_check, IN[1]=byName, IN[2]=input_check_2, IN[3]=select_model_elements)  # IronPython2
# ---------- category_filter.python (8 lines) ----------
outt = []

for i in range(len(IN[0])):
	if IN[0][i] ==IN[1]:
		outt.append(IN[2][i])
		
if IN[3] == []: OUT = None
else: OUT = outt
# ----------------------------------------
sorted = Python(IN[0]=category_filter)  # IronPython2
# ---------- sorted.python (16 lines) ----------
import clr
clr.AddReference('ProtoGeometry')
from Autodesk.DesignScript.Geometry import *
#The inputs to this node will be stored as a list in the IN variable.
inp = IN[0]
zz = []
for i in inp: zz.append(i.SheetNumber)

zipped = zip(zz,inp)

sorted_zipped_lists = sorted(zipped)

#crazy way to get the second element fom any sublist
sorted_list1 = [element for _, element in sorted_zipped_lists]

OUT = sorted_list1
# ----------------------------------------
watch = Watch(sorted)  # graph output
watch_2 = Watch(select_model_elements)  # graph output

current = Document.Current()
activeView = Document.ActiveView(document=current)
string_from_object = FromObject(obj=activeView)
code_block_2 = CodeBlock { "Sheet"; }
contains = String.Contains(str=string_from_object, searchFor=code_block_2)
watch_3 = Watch(activeView)

# group: check if a user in a view not in a Sheet --> get the Sheet
code_block_3 = CodeBlock { "Sheets"; }
byName_2 = Category.ByName(name=code_block_3)
all_elements_of_category = ElementsOfCategory(Category=byName_2)
string_from_object_2 = FromObject(obj=all_elements_of_category)
code_block_4 = CodeBlock { "Sheet(Name = "; }
split = String.Split(str=string_from_object_2, separator0=code_block_4)
code_block_5 = CodeBlock { " )"; }
split_2 = String.Split(str=split, separator0=code_block_5)
code_block_6 = CodeBlock { "Sheet Name"; }
parameterByName = Parameter.ParameterByName(element=watch_3, name=code_block_6)
string_from_object_3 = FromObject(obj=parameterByName)
code_block_7 = CodeBlock { "Sheet Name : "; }
split_3 = String.Split(str=string_from_object_3, separator0=code_block_7)
flatten = List.Flatten(list=split_3)
contains_2 = String.Contains(str=split_2, searchFor=flatten, lacing=Longest)
flatten_2 = List.Flatten(list=contains_2)
filterByBoolMask = List.FilterByBoolMask(list=all_elements_of_category, mask=flatten_2)
watch_4 = Watch(filterByBoolMask.in)

if_ = If(test=contains, true=activeView, false=filterByBoolMask.in)
firstItem = List.FirstItem(list=if_)
python_script = Python(IN[0]=sorted, IN[1]=firstItem)  # IronPython2
# ---------- python_script.python (4 lines) ----------
if IN[0] == None:
	OUT = IN[1]
else: OUT = IN[0]
	
# ----------------------------------------
input_check_3 = Python(IN[0]=python_script)  # IronPython2; same code as input_check
code_block_8 = CodeBlock { "Select"; }
printer = StringInput("TOSHIBA Universal Printer 2")
get_all_print_settings = Python()  # IronPython2; unwired: IN[0]
# ---------- get_all_print_settings.python (29 lines) ----------
import clr

clr.AddReference('RevitAPI')
from Autodesk.Revit.DB import *
clr.AddReference("RevitNodes")
import Revit
clr.ImportExtensions(Revit.Elements)

clr.AddReference("RevitServices")
import RevitServices
from RevitServices.Persistence import DocumentManager
from RevitServices.Transactions import TransactionManager


doc = DocumentManager.Instance.CurrentDBDocument

yy = FilteredElementCollector(doc).OfClass(PrintSetting).WhereElementIsNotElementType().ToElements()

zz = []
for i in yy: zz.append(i.Name)

t = zip(zz,yy)

flat_list = []
for sublist in t:
    for item in sublist:
        flat_list.append(item)

OUT = flat_list
# ----------------------------------------
string_from_object_4 = FromObject(obj=get_all_print_settings)
remove_formats = Python(IN[0]=string_from_object_4)  # IronPython2
# ---------- remove_formats.python (11 lines) ----------
printer_list = IN[0]

out = []
for i in printer_list:
	if i == 'pdfFactory Pro_Default A2':	
		i = 'format removed'
	if i == 'pdfFactory Pro_Default A1':	
		i = 'format removed'				
	out.append(i)

OUT = out
# ----------------------------------------
python_script_2 = Python(IN[0]=sorted, IN[1]=if_)  # IronPython2; same code as python_script
get_the_titleblock_size = Python(IN[0]=python_script_2)  # IronPython2
# ---------- get_the_titleblock_size.python (25 lines) ----------
import clr
clr.AddReference('RevitNodes')
import Revit
clr.ImportExtensions(Revit.GeometryConversion)

clr.AddReference('RevitAPI')
import Autodesk
from Autodesk.Revit.DB import *

clr.AddReference("RevitServices")
import RevitServices
from RevitServices.Persistence import DocumentManager
doc = DocumentManager.Instance.CurrentDBDocument

toList = lambda x : x if hasattr(x, '__iter__') else [x]
out= []

viewlst = toList(UnwrapElement(IN[0]))
for view in viewlst:
	titleBkl = FilteredElementCollector(doc, view.Id).OfClass(FamilyInstance).OfCategory(BuiltInCategory.OST_TitleBlocks).FirstElement()
	bbx = titleBkl.get_BoundingBox(view)
	width = bbx.Max.ToPoint().X - bbx.Min.ToPoint().X
	height = bbx.Max.ToPoint().Y - bbx.Min.ToPoint().Y
	out.append("{} x {}".format(width, height))
OUT = out
# ----------------------------------------
string = StringInput(" x ")
split_4 = String.Split(str=get_the_titleblock_size, separator0=string)
firstItem_2 = List.FirstItem(list=split_4, lacing=Longest)
input_check_4 = Python(IN[0]=firstItem_2)  # IronPython2; same code as input_check
get_name_from_size = Python(IN[0]=input_check_4)  # IronPython2
# ---------- get_name_from_size.python (11 lines) ----------
outp = []

for i in IN[0]:

	inp = int(float(i))
	if inp == 841: outp.append('A1')
	elif inp==594: outp.append('A2')
	elif inp==297: outp.append('A4')		
	else: outp.append('A3')#default scenrio
		
OUT = outp
# ----------------------------------------
find_from_name = Python(IN[0]=remove_formats, IN[1]=get_name_from_size, IN[2]=get_all_print_settings)  # IronPython2
# ---------- find_from_name.python (11 lines) ----------
inp = IN[1]
search = IN[0]
obj = IN[2]
z = []

for i in inp:
	for j in range(len(search)):
		if i in search[j]: z.append(obj[j+1])


OUT = z
# ----------------------------------------
run_it = BoolSelector(true)
print_pdf_by_https_archi_lab_net = Python(IN[0]=input_check_3, IN[1]=code_block_8, IN[3]=printer, IN[4]=find_from_name, IN[6]=run_it)  # "print PDF by https://archi-lab.net/printing-pdfs-w-dynamo/"; IronPython2; unwired: IN[2], IN[5]
# ---------- print_pdf_by_https_archi_lab_net.python (125 lines) ----------
#Copyright(c) 2015, Konrad K Sobon
# @arch_laboratory, http://archi-lab.net

import clr
clr.AddReference('ProtoGeometry')
from Autodesk.DesignScript.Geometry import *

# Import Element wrapper extension methods
clr.AddReference("RevitNodes")
import Revit
clr.ImportExtensions(Revit.Elements)

# Import geometry conversion extension methods
clr.ImportExtensions(Revit.GeometryConversion)

# Import DocumentManager and TransactionManager
clr.AddReference("RevitServices")
import RevitServices
from RevitServices.Persistence import DocumentManager
from RevitServices.Transactions import TransactionManager

doc = DocumentManager.Instance.CurrentDBDocument
uiapp = DocumentManager.Instance.CurrentUIApplication
app = uiapp.Application

# Import RevitAPI
clr.AddReference("RevitAPI")
import Autodesk
from Autodesk.Revit.DB import *

import sys
pyt_path = r'C:\Program Files (x86)\IronPython 2.7\Lib'
sys.path.append(pyt_path)
import System

#The inputs to this node will be stored as a list in the IN variable.
dataEnteringNode = IN

sheets = IN[0]
pRange = System.Enum.Parse(Autodesk.Revit.DB.PrintRange, IN[1])
#combined = IN[2]
printerName = IN[3]
printsetting = IN[4]
filePath = IN[5]
runIt = IN[6]

if isinstance(sheets, list):
	viewSheets = []
	for i in sheets:
		viewSheets.append(UnwrapElement(i))
else:
	viewSheets = UnwrapElement(sheets)
	
if isinstance(printsetting, list):
	printSetting = []
	for i in printsetting:
		printSetting.append(UnwrapElement(i))
else:
	printSetting = UnwrapElement(printsetting)

def PrintView(doc, sheet, pRange, printerName, printSetting):
	TransactionManager.Instance.EnsureInTransaction(doc)
	# create view set 
	viewSet = ViewSet()
	viewSet.Insert(sheet)
	# determine print range
	printManager = doc.PrintManager
	printManager.PrintRange = pRange
	printManager.Apply()
	# make new view set current
	viewSheetSetting = printManager.ViewSheetSetting
	viewSheetSetting.CurrentViewSheetSet.Views = viewSet
	# set printer
	printManager.SelectNewPrintDriver(printerName)
	printManager.Apply()
	# set combined and print to file

	
	printSetup = printManager.PrintSetup
	printSetup.CurrentPrintSetting = printSetting
	printManager.Apply()

	# save settings and submit print

	viewSheetSetting.SaveAs("tempSetName")
	printManager.Apply()
	printManager.SubmitPrint()
	viewSheetSetting.Delete()
	TransactionManager.Instance.TransactionTaskDone()
	
	return True

try:
	viewSets = FilteredElementCollector(doc).OfClass(ViewSheetSet)
	for i in viewSets:
		if i.Name == "tempSetName":
			TransactionManager.Instance.EnsureInTransaction(doc)
			doc.Delete(i.Id)
			TransactionManager.Instance.ForceCloseTransaction()
		else:
			continue
		
	errorReport = None
	message = "Success"
	if runIt:
		if isinstance(viewSheets, list) and isinstance(printSetting, list):
			for i, j in zip(viewSheets, printSetting):
				PrintView(doc, i, pRange, printerName,  j)
		elif isinstance(viewSheets, list) and not isinstance(printSetting, list):
			for i in viewSheets:
				PrintView(doc, i, pRange, printerName, printSetting)
		elif not isinstance(viewSheets, list) and not isinstance(printSetting, list):
			PrintView(doc, viewSheets, pRange, printerName, printSetting)
	else:
		message = "Set RunIt to True"
except:
	# if error accurs anywhere in the process catch it
	import traceback
	errorReport = traceback.format_exc()
	
#Assign your output to the OUT variable
if errorReport == None:
	OUT = message
else:
	OUT = errorReport
# ----------------------------------------
printer_2 = StringInput("pdfFactory Pro")
code_block_9 = CodeBlock { "0_views"; "1 print range"; "3 printer name"; "4 print settings"; "6 runit"; }
code_block_10 = CodeBlock { "this is for automatic sheet sizing"; }
watch_5 = Watch(if_)
watch_6 = Watch(get_name_from_size)  # graph output
