# Dynamo graph Sheets_END_to_rename.dyn (Dynamo 2.6.1.8786)

code_block = CodeBlock { "Sheets"; }
byName = Category.ByName(name=code_block)
all_elements_of_category = ElementsOfCategory(Category=byName)

# group: generating list required to rename
rename_from = StringInput("A29")  # graph input
code_block_2 = CodeBlock { "0"; }
code_block_3 = CodeBlock { 1; }
code_block_4 = CodeBlock { 10; }
code_block_5 = CodeBlock { 9; }

beginning = Python(IN[0]=rename_from)
# ---------- beginning.python (13 lines) ----------
if isinstance(IN[0], list): x = IN[0]
else: x = [IN[0]]
z = []

if "." in x[0]: 
	for i in x:
		z.append(i.split(".")[0])
else: 
	for i in x:
		z.append(filter(str.isalpha, i[:-1])) #x[:-1] to avoid situations where a letter at the end


OUT = z
# ----------------------------------------
code_block_6 = CodeBlock(x=beginning) { x[0]; }
check_for_special_symbol = Python(IN[0]=rename_from)
# ---------- check_for_special_symbol.python (8 lines) ----------
x = IN[0]
z = ""
if "." in x: z = "."
else: 
	z = ""


OUT = z
# ----------------------------------------
end = Python(IN[0]=rename_from)
# ---------- end.python (14 lines) ----------
if isinstance(IN[0], list):
	x = IN[0]
else: x = [IN[0]]
z = []

if "." in x[0]: 
	for i in x:
		z.append(int(i.split(".")[1]))
else: 
	for i in x:
		z.append(int(filter(str.isdigit, i)))


OUT = z
# ----------------------------------------
code_block_7 = CodeBlock(x=end) { x[0]; }
up_to_n_sheets = DoubleInput(20)  # graph input
add = code_block_7 + up_to_n_sheets

# group (continued): generating list required to rename
code_block_8 = CodeBlock(first=code_block_7, second=add, spc=code_block_3) { first..second..~spc; }
lt = code_block_8 < code_block_4
filterByBoolMask = List.FilterByBoolMask(list=code_block_8, mask=lt)
watch = Watch(filterByBoolMask.in)
code_block_9 = CodeBlock(one=code_block_6, two=check_for_special_symbol, three=code_block_2, four=watch) { one+two+three+four; }
gt = code_block_8 > code_block_5
filterByBoolMask_2 = List.FilterByBoolMask(list=code_block_8, mask=gt)
code_block_10 = CodeBlock(one=code_block_6, two=check_for_special_symbol, three=filterByBoolMask_2.in) { one+two+three; }
list_create = List.Create(item0=code_block_9, item1=code_block_10)
flatten = List.Flatten(list=list_create)

# group: Filter existing sheets to find required
code_block_11 = CodeBlock { "Sheet Number"; }
parameterByName = Parameter.ParameterByName(element=all_elements_of_category, name=code_block_11)
string_from_object = FromObject(obj=parameterByName)
code_block_12 = CodeBlock { " : "; }
split = String.Split(str=string_from_object, separator0=code_block_12)
code_block_13 = CodeBlock { 2; }
code_block_14 = CodeBlock { -1; }
dropEveryNthItem = List.DropEveryNthItem(list=split, n=code_block_13, offset=code_block_14, lacing=Longest)
flatten_2 = List.Flatten(list=dropEveryNthItem)
boolean = BoolSelector(true)

sorted = Python(IN[0]=all_elements_of_category, IN[1]=flatten_2)
# ---------- sorted.python (12 lines) ----------
inp = IN[0]
sorting = IN[1]


zipped = zip(sorting,inp)

sorted_zipped_lists = sorted(zipped)

#crazy way to get the second element fom any sublist
sorted_list1 = [element for _, element in sorted_zipped_lists]

OUT = sorted_list1 
# ----------------------------------------

# group (continued): Filter existing sheets to find required
watch_2 = Watch(sorted)

sorted_2 = Python(IN[0]=flatten_2)
# ---------- sorted_2.python (1 lines) ----------
OUT = sorted(IN[0])
# ----------------------------------------

# group (continued): Filter existing sheets to find required
contains = List.Contains(list=sorted_2, item=flatten, lacing=CrossProduct)
contains_2 = List.Contains(list=contains, item=boolean, lacing=Longest)
filterByBoolMask_3 = List.FilterByBoolMask(list=watch_2, mask=contains_2)
watch_3 = Watch(filterByBoolMask_3.in)

watch_4 = Watch(watch_3)

# group: getting sheets numbers
code_block_15 = CodeBlock { "Sheet Number"; }
parameterByName_2 = Parameter.ParameterByName(element=watch_3, name=code_block_15)
string_from_object_2 = FromObject(obj=parameterByName_2)
code_block_16 = CodeBlock { " : "; }
split_2 = String.Split(str=string_from_object_2, separator0=code_block_16)
code_block_17 = CodeBlock { 2; }
code_block_18 = CodeBlock { -1; }
dropEveryNthItem_2 = List.DropEveryNthItem(list=split_2, n=code_block_17, offset=code_block_18, lacing=Longest)
flatten_3 = List.Flatten(list=dropEveryNthItem_2)

rand = Math.Rand()
code_block_19 = CodeBlock { 1000; }
mul = rand * code_block_19

# group: +x in the same order
beginning_2 = Python(IN[0]=flatten_3)  # same code as beginning
end_2 = Python(IN[0]=flatten_3)  # same code as end
ceiling = Math.Ceiling(number=mul)
code_block_20 = CodeBlock(one=beginning_2, two=end_2, three=ceiling) { one+two+three; }

# group: fake rename to avoid error
setParameterByName = Element.SetParameterByName(element=watch_4, parameterName=code_block_15, value=code_block_20)

# group: +/- number in the same order
beginning_3 = Python(IN[0]=flatten_3)  # same code as beginning
check_for_special_symbol_2 = Python(IN[0]=flatten_3)
# ---------- check_for_special_symbol_2.python (8 lines) ----------
x = IN[0][0]
z = ""
if "." in x: z = "."
else: 
	z = ""


OUT = z
# ----------------------------------------
code_block_21 = CodeBlock { "0"; }
end_3 = Python(IN[0]=flatten_3)  # same code as end
x_or_x_sheets = StringInput("+1")  # graph input
toNumber = String.ToNumber(str=x_or_x_sheets)
add_2 = end_3 + toNumber
code_block_22 = CodeBlock { 10; }
lt_2 = add_2 < code_block_22
filterByBoolMask_4 = List.FilterByBoolMask(list=add_2, mask=lt_2)
watch_5 = Watch(filterByBoolMask_4.in)
code_block_23 = CodeBlock(one=beginning_3, two=check_for_special_symbol_2, three=code_block_21, four=watch_5) { one+two+three+four; }
code_block_24 = CodeBlock { 9; }
gt_2 = add_2 > code_block_24
filterByBoolMask_5 = List.FilterByBoolMask(list=add_2, mask=gt_2)
code_block_25 = CodeBlock(one=beginning_3, two=check_for_special_symbol_2, three=filterByBoolMask_5.in) { one+two+three; }
list_create_2 = List.Create(item0=code_block_23, item1=code_block_25)
flatten_4 = List.Flatten(list=list_create_2)

setParameterByName_2 = Element.SetParameterByName(element=setParameterByName, parameterName=code_block_15, value=flatten_4)
