# Dynamo graph Sheets_PREFIX_to_rename.dyn (Dynamo 2.6.1.8786)

code_block = CodeBlock { "Sheets"; }
byName = Category.ByName(name=code_block)
all_elements_of_category = ElementsOfCategory(Category=byName)
watch = Watch(all_elements_of_category)
code_block_2 = CodeBlock { "Sheet Number"; }
parameterByName = Parameter.ParameterByName(element=all_elements_of_category, name=code_block_2)
string_from_object = FromObject(obj=parameterByName)
code_block_3 = CodeBlock { " : "; }
split = String.Split(str=string_from_object, separator0=code_block_3)
code_block_4 = CodeBlock { 2; }
code_block_5 = CodeBlock { -1; }
dropEveryNthItem = List.DropEveryNthItem(list=split, n=code_block_4, offset=code_block_5, lacing=Longest)
flatten = List.Flatten(list=dropEveryNthItem)
what_to_rename = StringInput("S7")  # graph input
code_block_6 = CodeBlock { ".0"; }
number = DoubleInput(1)
number_2 = DoubleInput(9)
code_block_7 = CodeBlock { 1; }
code_block_8 = CodeBlock(first=number, second=number_2, spc=code_block_7) { first..second..~spc; }
code_block_9 = CodeBlock(one=what_to_rename, two=code_block_6, three=code_block_8) { one+two+three; }
code_block_10 = CodeBlock { "."; }
number_3 = DoubleInput(10)
up_to_n_sheets = DoubleInput(40)  # graph input
code_block_11 = CodeBlock { 1; }
code_block_12 = CodeBlock(first=number_3, second=up_to_n_sheets, spc=code_block_11) { first..second..~spc; }
code_block_13 = CodeBlock(one=what_to_rename, two=code_block_10, three=code_block_12) { one+two+three; }
list_create = List.Create(item0=code_block_9, item1=code_block_13)
flatten_2 = List.Flatten(list=list_create)
contains = List.Contains(list=flatten, item=flatten_2, lacing=CrossProduct)
boolean = BoolSelector(true)
contains_2 = List.Contains(list=contains, item=boolean, lacing=Longest)
filterByBoolMask = List.FilterByBoolMask(list=watch, mask=contains_2)
watch_2 = Watch(filterByBoolMask.in)
code_block_14 = CodeBlock { "Sheet Number"; }
parameterByName_2 = Parameter.ParameterByName(element=watch_2, name=code_block_14)
string_from_object_2 = FromObject(obj=parameterByName_2)
code_block_15 = CodeBlock { " : "; }
split_2 = String.Split(str=string_from_object_2, separator0=code_block_15)
code_block_16 = CodeBlock { 2; }
code_block_17 = CodeBlock { -1; }
dropEveryNthItem_2 = List.DropEveryNthItem(list=split_2, n=code_block_16, offset=code_block_17, lacing=Longest)
flatten_3 = List.Flatten(list=dropEveryNthItem_2)
watch_3 = Watch(what_to_rename)
rename_to = StringInput("S6")  # graph input
replace = String.Replace(str=flatten_3, searchFor=watch_3, replaceWith=rename_to)
setParameterByName = Element.SetParameterByName(element=watch_2, parameterName=code_block_14, value=replace)
