# Dynamo graph View_last_on_Sheet.dyn (Dynamo 2.6.1.8786)

string = StringInput("""import clr

clr.AddReference("RevitServices")
import RevitServices
from RevitServices.Persistence import DocumentManager
from RevitServices.Transactions import TransactionManager
doc =  DocumentManager.Instance.CurrentDBDocument
app = DocumentManager.Instance.CurrentUIApplication.Application

clr.AddReference("RevitAPI")
from Autodesk.Revit.DB import *

View = doc.ActiveView
OUT = View""")
python_script_from_string = PythonStringNode(script=string)
code_block = CodeBlock { "Views"; }
byName = Category.ByName(name=code_block)
all_elements_of_category = ElementsOfCategory(Category=byName)
input_check = Python(IN[0]=all_elements_of_category)
# ---------- input_check.python (8 lines) ----------
input = IN[0]
elements = []

if isinstance(input, list): 
	for i in input:	elements.append(i)
else: elements = [input]
		
OUT = elements
# ----------------------------------------
string_from_object = FromObject(obj=input_check)
null_check = Python(IN[0]=string_from_object, IN[1]=input_check)
# ---------- null_check.python (12 lines) ----------
strings = IN[0]
list = IN[1]

elements = []


for a,b in zip(strings, list):	
	if a != "null":
		elements.append(b)

		
OUT = elements
# ----------------------------------------
template_check = Python(IN[0]=null_check)
# ---------- template_check.python (12 lines) ----------
# Load the Python Standard and DesignScript Libraries
#import sys
#import clr
#clr.AddReference("RevitAPI")


xz = []
for i in IN[0]:
	if UnwrapElement(i).IsTemplate==False:
		xz.append(i)

OUT =xz 
# ----------------------------------------
get_last_not_on_sheet = Python(IN[0]=template_check)
# ---------- get_last_not_on_sheet.python (29 lines) ----------
# Load the Python Standard and DesignScript Libraries
import sys
import clr
clr.AddReference("RevitAPI")
from Autodesk.Revit.DB import *

xz = []
for i in IN[0]:
	xz.append(UnwrapElement(i))

def func(list, i):
	dg = []
	ff = list[len(list)-i]	
	fg =ff.GetParameters("Sheet Name")
	if not fg: #check if exists
		return ff
	else:
		return list[:-1]

mm = func(xz,1)

zx = []

while type(mm) is list and len(mm)>1:	
	#param = param+1
	mm = func(mm,1)
	#zx.append("+1")

OUT = mm
# ----------------------------------------
watch = Watch(get_last_not_on_sheet)
active_view_central_point = Python()  # unwired: IN[0]
# ---------- active_view_central_point.python (49 lines) ----------
import sys
import clr
clr.AddReference('ProtoGeometry')
from Autodesk.DesignScript.Geometry import *
clr.AddReference("RevitServices")
import RevitServices
from RevitServices.Persistence import DocumentManager
from RevitServices.Transactions import TransactionManager


clr.AddReference('RevitAPI')
from Autodesk.Revit.DB import *
from Autodesk.Revit.DB import Transaction

doc = DocumentManager.Instance.CurrentDBDocument
uidoc=DocumentManager.Instance.CurrentUIApplication.ActiveUIDocument


x = uidoc.GetOpenUIViews()
z = []
for i in x: z.append(i.ViewId)
h = doc.ActiveView.Id


ff = 231



test = []
for i in z:
	if h == i: test.append("True")
	else: test.append("False")

for i in x:
	test.append(i.GetZoomCorners())

zz = zip(z,test,x)

res = []
for i in range(0,len(zz)):
	if zz[i][1] == "True": res.append(zz[i][2])
	

z = res[0].GetZoomCorners()

point = (z[0][0]+z[1][0])/2, (z[0][1]+z[1][1])/2


OUT = point
# ----------------------------------------
code_block_2 = CodeBlock { 304.8; }
to_mm = active_view_central_point * code_block_2
firstItem = List.FirstItem(list=to_mm)
lastItem = List.LastItem(list=to_mm)
code_block_3 = CodeBlock { 0; }
sub = lastItem - code_block_3
code_block_4 = CodeBlock { 0; }
byCoordinates = Point.ByCoordinates(x=firstItem, y=sub, z=code_block_4)
place_views_on_sheet_py = Python(IN[0]=python_script_from_string, IN[1]=watch, IN[2]=byCoordinates)
# ---------- place_views_on_sheet_py.python (33 lines) ----------
################### Import References ###################
import clr

clr.AddReference("RevitServices")
import RevitServices
from RevitServices.Persistence import DocumentManager
from RevitServices.Transactions import TransactionManager
doc =  DocumentManager.Instance.CurrentDBDocument
app = DocumentManager.Instance.CurrentUIApplication.Application

clr.AddReference("RevitNodes")
import Revit
clr.ImportExtensions(Revit.Elements)
clr.ImportExtensions(Revit.GeometryConversion)

clr.AddReference("RevitAPI")
from Autodesk.Revit.DB import *
################### Definitions ###################


################### Outputs ###################
sht = UnwrapElement(IN[0])
v = UnwrapElement(IN[1])
l = UnwrapElement(IN[2])
################### Script ###################



TransactionManager.Instance.EnsureInTransaction(doc)
vp = Viewport.Create(doc,sht.Id,v.Id,l.ToXyz())
	
	
OUT = v
# ----------------------------------------
get_last_not_on_sheet_2 = Python(IN[0]=template_check)
# ---------- get_last_not_on_sheet_2.python (29 lines) ----------
# Load the Python Standard and DesignScript Libraries
import sys
import clr
clr.AddReference("RevitAPI")
from Autodesk.Revit.DB import *

xz = []
for i in IN[0]:
	xz.append(UnwrapElement(i))

def func(list, i):
	dg = []
	ff = list[len(list)-i]	
	fg =ff.GetParameters("Sheet Name")
	if not fg: #check if exists
		return ff
	else:
		return list[:-1]

mm = func(xz,1)
param = 1
zx = []

while type(mm) is list:	
	#param = param+1
	mm = func(mm,1)
	zx.append("+1")

OUT = zx
# ----------------------------------------
watch_2 = Watch(get_last_not_on_sheet_2)
reverse = List.Reverse(list=template_check)
watch_3 = Watch(reverse)
pop_up_message = Python(IN[0]=watch)
# ---------- pop_up_message.python (16 lines) ----------
#This script pops up a dialog box with a message from the previous node.
import clr
clr.AddReference('RevitAPIUI')



mainText = IN[0]


if not mainText: 
	from Autodesk.Revit.UI import TaskDialog
	messagePop = TaskDialog("Dynamo Player")
	messagePop.MainContent = "no views found" 
	messagePop.Show()

OUT = "Success!"
# ----------------------------------------
